# Grasshopper definition visualize_hbjson_model.gh (Grasshopper 1.0.7)
# plug-ins: Ironbug.LBHB_Legacy

path_to_hbjson = Panel("C:\Users\elie-medioni\OneDrive\OneDrive - Technion\BUA\Hilany\Samples\model_no_shade_win_not_el.hbjson")
load_the_object = Ladybug_FalseStartToggle(False)
loadobjects = HBLoadObjects(hb_file=path_to_hbjson, load=load_the_object)  # -> report, hb_objs; plug-in component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
vizbytype = HBVisualizeByType(hb_objs=loadobjects.hb_objs)  # -> walls, interior_walls, roofs, ceilings, exterior_floors, interior_floors, air_walls, apertures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; plug-in component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
vizbybc = HBVisualizeByBC(hb_objs=loadobjects.hb_objs)  # -> outdoors, surface, ground, adiabatic, other, wire_frame; plug-in component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
